# Grasshopper definition to_pc_01.gh (Grasshopper 1.0.7)
# plug-ins: Volvox, Pufferfish, LunchBox, Human, Anemone, treesloth01, Tarsier

brep = Brep([<brep referenced from the Rhino model> x112])
mesh = Mesh([<mesh referenced from the Rhino model> x40])
mesh_2 = Mesh([<mesh referenced from the Rhino model> x14])
brep_2 = Brep([<brep referenced from the Rhino model> x7])
brep_3 = Brep([<brep referenced from the Rhino model> x2])
brep_4 = Brep([<brep referenced from the Rhino model> x2])
brep_5 = Brep([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])

# ---- group: day_06
curve = Curve([<curve referenced from the Rhino model> x37])

# ---- group: day_07
curve_2 = Curve([<curve referenced from the Rhino model> x44])

# ---- group: day_02
curve_3 = Curve([<curve referenced from the Rhino model> x32])

# ---- group: day_03
curve_4 = Curve([<curve referenced from the Rhino model> x34])

# ---- group: day_04
curve_5 = Curve([<curve referenced from the Rhino model> x31])

# ---- group: day_05
curve_6 = Curve([<curve referenced from the Rhino model> x34])

# ---- group: day_01
# data_days
curve_7 = Curve([<curve referenced from the Rhino model> x25])

# ---- group: Interaction
curve_8 = Curve([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])

# ----
brep_6 = Brep([<brep referenced from the Rhino model> x60])
brep_7 = Brep([<brep referenced from the Rhino model> x60])
face_normals = FaceNormals(Mesh=mesh_2)  # -> Centers, Normals
face_normals_2 = FaceNormals(Mesh=mesh)  # -> Centers, Normals
number_slider = Slider(250, range=0..1000)
merge = Merge(Data1=brep_6, Data2=brep_7)
surface = Surface(<surface referenced from the Rhino model>)
curve_9 = Curve([<curve referenced from the Rhino model> x15])
curve_10 = Curve([<curve referenced from the Rhino model> x10])
file_path = FilePath("C:\Users\secg\Documents\iokan\projects\MACAD\AIA21\AIA-data_encoding\repo_reference_01\Grasshopper_DQN_b\neo\07_boundary_test\data_last_point_facade_d\dqn_outputs_01.csv")  # disabled
explode = Explode(Curve=curve_10, Recursive=True)  # -> Segments, Vertices
rectangle = Rectangle(surface)
number_slider_2 = Slider(146, range=0..1000)
area = Area(Geometry=merge)  # -> Area, Centroid
ghpython_script = GhPythonScript(csvPath=file_path)  # -> out, action, reward, score, episode; disabled
# ---------- ghpython_script: Python ----------
import csv
import System.Convert as convert

data = open(csvPath)

csvLine = csv.reader(data)

a = []
for i in data:
    splitData = i.split(',')
    for j in splitData:
        splitA = j.rsplit(',')
    
    a.append(splitData)


csvLines = a[:]



act = []
rew = []
scr = []
e = []

for rowData in csvLines:
    act.append(rowData[0])
    rew.append(rowData[1])
    scr.append(rowData[2])
    e.append(rowData[-1])


action = act
reward = rew
score = scr
episode = e
# ---------- end ghpython_script ----------
unit_z = UnitZ(Factor=number_slider)
multiplication = Multiplication(A=number_slider, B=Slider(0.838, range=0..10))
random_reduce = RandomReduce(List=face_normals.Centers, Reduction=Slider(64000, range=0..1000000), Seed=1)
explode_2 = Explode(Curve=rectangle, Recursive=True)  # -> Segments, Vertices
number_slider_3 = Slider(45, range=0..100)
trim_with_region = TrimWithRegion(Curve=curve_8, Region=surface)  # -> flatten(Inside), Outside
random_reduce_2 = RandomReduce(List=face_normals_2.Centers, Reduction=Slider(288000, range=0..1000000), Seed=1)
unit_z_2 = UnitZ(Factor=multiplication)
list_item = ListItem(List=explode.Vertices, Index=Slider(3, range=0..10), Wrap=True)
unit_y = UnitY(Factor=1)
negative = Negative(Value=number_slider_2)
move = Move(Geometry=area.Centroid, Motion=unit_z)  # -> Geometry, Transform
length = Length(Curve=explode_2.Segments)
move_2 = Move(Geometry=move.Geometry, Motion=unit_z_2)  # -> Geometry, Transform
curve_11 = Curve(trim_with_region.Inside)
multiplication_2 = Multiplication(A="1000", B=Slider(0.3, range=0..1))
multiplication_3 = Multiplication(A="1000", B=Slider(0.2, range=0..1))
populate_geometry = PopulateGeometry(Geometry=brep_2, Count=Slider(1679, range=0..10000), Seed=1)  # -> flatten(Population)
populate_geometry_2 = PopulateGeometry(Geometry=brep_5, Count=Slider(1679, range=0..10000), Seed=1)  # -> flatten(Population)
populate_geometry_3 = PopulateGeometry(Geometry=brep_3, Count=Slider(1679, range=0..10000), Seed=1)  # -> flatten(Population)
populate_geometry_4 = PopulateGeometry(Geometry=brep_4, Count=Slider(500, range=0..10000), Seed=1)  # -> flatten(Population)
list_length = ListLength(List=curve_8)
flatten_tree = FlattenTree(Tree=random_reduce_2, Path="{0}")
flatten_tree_2 = FlattenTree(Tree=random_reduce, Path="{0}")
populate_geometry_5 = PopulateGeometry(Geometry=brep, Count=Slider(20, range=0..100), Seed=1)  # -> flatten(Population)
multiplication_4 = Multiplication(A="1000", B=Slider(0.25, range=0..1))
list_length_2 = ListLength(List=curve_11)
division = Division(A=length, B="1000")
list_indices = ListIndices(List=move.Geometry)
construct_domain = ConstructDomain(DomainStart=multiplication_3, DomainEnd=multiplication_2)
negative_2 = Negative(Value=number_slider_3)
length_2 = Length(Curve=curve_8)
param_viewer = ParamViewer(random_reduce_2)
line_sdl = LineSDL(Start=list_item, Direction=unit_y, Length=[number_slider_2, negative])
concatenate = Concatenate(FragmentA="shoe", FragmentB=list_indices)
division_2 = Division(A=length, B=multiplication_4)
sphere = Sphere(Base=move.Geometry, Radius=Slider(62.36, range=0..1000))
yz_plane = YZPlane(Origin=move_2.Geometry)
random_reduce_3 = RandomReduce(List=flatten_tree, Reduction=Slider(580000, range=0..1000000), Seed=1)
plane = Plane(list_item)
series = Series(Start=0, Step=1, Count=list_length_2)
repeat_data = RepeatData(Data="3", Length=list_length_2)
radians = Radians(Degrees=[number_slider_3, negative_2])
round = Round(Number=division_2)  # -> Nearest, Floor, Ceiling
random = Random(Range=construct_domain, Number=list_length, Seed=2)
list_length_3 = ListLength(List=populate_geometry)
list_length_4 = ListLength(List=populate_geometry_2)
list_length_5 = ListLength(List=populate_geometry_4)
list_length_6 = ListLength(List=populate_geometry_3)
custom_preview = CustomPreview(Geometry=sphere, Material=ColourSwatch(SwatchColor=RGBA(252, 244, 8, 76)))
join_curves = JoinCurves(Curves=line_sdl, Preserve=False)
list_length_7 = ListLength(List=random_reduce_3)
list_length_8 = ListLength(List=flatten_tree_2)
list_length_9 = ListLength(List=populate_geometry_5)
number_slider_4 = Slider(0.66, range=0..1)
division_3 = Division(A=length_2, B=random)
list_item_2 = ListItem(List=round.Nearest, Index=0, Wrap=True)  # -> Item, Item1
text_tag_3d = TextTag3D(
    Location=yz_plane,
    Text=concatenate,
    Size=Slider(50, range=0..100),
    Colour=ColourSwatch(SwatchColor=RGB(0, 0, 0)),
    Justification=5)
panel = Panel("""M
F""")
panel_2 = Panel("""1
2
3
4""")
panel_3 = Panel("""CA
IN
AS
ME
AF
OT""")
rotate = Rotate(Geometry=join_curves, Angle=radians, Plane=plane)  # -> Geometry, Transform
repeat_data_2 = RepeatData(Data="255,255,255", Length=list_length_7)
repeat_data_3 = RepeatData(Data="255,255,255", Length=list_length_8)
repeat_data_4 = RepeatData(Data="255,255,255", Length=list_length_9)
random_2 = Random(Range="6", Number=repeat_data, Seed=series)  # -> simplify(Random)
repeat_data_5 = RepeatData(Data="255,255,255", Length=list_length_5)
repeat_data_6 = RepeatData(Data="255,255,255", Length=list_length_3)
repeat_data_7 = RepeatData(Data="255,255,255", Length=list_length_6)
repeat_data_8 = RepeatData(Data="255,255,255", Length=list_length_4)
mass_addition = MassAddition(Input=division_3)  # -> Result, PartialResults
panel_4 = Panel("""0
1""")
panel_5 = Panel("""0
1
2
3""")
panel_6 = Panel("""0
1
2
3
4
5""")
mesh_plane = MeshPlane(Boundary=surface, WidthCount=list_item_2.Item, HeightCount=list_item_2.Item1)  # -> Mesh, Area
merge_2 = Merge(Data1=list_item_2.Item, Data2=list_item_2.Item1)
populate_geometry_6 = PopulateGeometry(Geometry=curve_8, Count=division_3, Seed=1)
multiplication_5 = Multiplication(A="1000", B=number_slider_4)
construct_cloud = ConstructCloud(Points=populate_geometry, Colors=repeat_data_6)
construct_cloud_2 = ConstructCloud(Points=populate_geometry_2, Colors=repeat_data_8)
construct_cloud_3 = ConstructCloud(Points=random_reduce_3, Colors=repeat_data_2)
construct_cloud_4 = ConstructCloud(Points=flatten_tree_2, Colors=repeat_data_3)
construct_cloud_5 = ConstructCloud(Points=populate_geometry_5, Colors=repeat_data_4)
construct_cloud_6 = ConstructCloud(Points=populate_geometry_3, Colors=repeat_data_7)
construct_cloud_7 = ConstructCloud(Points=populate_geometry_4, Colors=repeat_data_5)
face_boundaries = FaceBoundaries(Mesh=mesh_plane.Mesh)
list_item_3 = ListItem(List=random_2, Index=0, Wrap=True)  # -> Item, Item1, Item2
panel_7 = Panel(random_2)
multiplication_6 = Multiplication(A=mass_addition.Result, B=number_slider_4)
sort_along_curve = SortAlongCurve(Points=populate_geometry_6, Curve=graft(curve_8))  # -> simplify(Points), Indices
custom_preview_lineweights = CustomPreviewLineweights(
    Geometry=rotate.Geometry,
    Shader=ColourSwatch(SwatchColor=RGB(0, 0, 0)),
    Thickness=Slider(2, range=0..10),
    Absolute=False)
tree_statistics = TreeStatistics(Tree=populate_geometry_6)  # -> Paths, Length, Count
area_2 = Area(Geometry=face_boundaries)  # -> Area, Centroid
random_3 = Random(Range=multiplication_6, Number=list_length, Seed=2)
list_item_4 = ListItem(List=panel_4, Index=list_item_3.Item, Wrap=True)
list_item_5 = ListItem(List=panel_5, Index=list_item_3.Item1, Wrap=True)
list_item_6 = ListItem(List=panel_6, Index=list_item_3.Item2, Wrap=True)
deconstruct_cloud = DeconstructCloud(Cloud=construct_cloud_3)  # -> Points, Normals, Colors
range = Range(Domain=Domain(0, 1), Steps=expr("x-1", tree_statistics.Count))
list_length_10 = ListLength(List=populate_geometry_6)
integer = Integer(graft(random_3))
point = Point(simplify(sort_along_curve.Points))
merge_3 = Merge(Data1=list_item_4, Data2=list_item_5, Data3=list_item_6)
addition = Addition(A=integer, B=graft(range))
proximity_3d = Proximity3D(Points=deconstruct_cloud.Points, Group=5)  # -> Links, Topology
division_4 = Division(
    A=[flatten_tree_2, populate_geometry_5, populate_geometry_3, populate_geometry_4, populate_geometry, populate_geometry_2],
    B=Slider(1000, range=0..1000))  # -> flatten(Result)
closest_point = ClosestPoint(Point=point, Cloud=area_2.Centroid)  # -> ClosestPoint, simplify(CPIndex), Distance
text_join = TextJoin(Text=merge_3, Join=";")  # -> flatten(Result)
flatten_tree_3 = FlattenTree(Tree=deconstruct_cloud.Points, Path="{0}")
division_5 = Division(A=random_reduce_3, B=Slider(1000, range=0..1000))
length_3 = Length(Curve=proximity_3d.Links)
repeat_data_9 = RepeatData(Data=graft(text_join), Length=list_length_10)  # -> simplify(Data)
series_2 = Series(Start=addition, Step=1, Count=list_length_10)  # -> simplify(Series)
deconstruct = Deconstruct(Point=division_5)  # -> XComponent, YComponent, ZComponent
deconstruct_2 = Deconstruct(Point=division_4)  # -> XComponent, YComponent, ZComponent
panel_8 = Panel(text_join)
average = Average(Input=length_3)  # -> flatten(ArithmeticMean)
sort_list = SortList(Keys=flatten(series_2), ValuesA=flatten(closest_point.CPIndex), ValuesB=flatten(repeat_data_9))  # -> Keys, ValuesA, ValuesB
logarithm = Logarithm(Value=average)
round_to_decimal_place = RoundToDecimalPlace(NumberX=deconstruct.XComponent, DecimalPlace="2", RoundType=0)  # -> Rounded, Difference
round_to_decimal_place_2 = RoundToDecimalPlace(NumberX=deconstruct.YComponent, DecimalPlace="2", RoundType=0)  # -> Rounded, Difference
round_to_decimal_place_3 = RoundToDecimalPlace(NumberX=deconstruct.ZComponent, DecimalPlace="2", RoundType=0)  # -> Rounded, Difference
round_to_decimal_place_4 = RoundToDecimalPlace(NumberX=deconstruct_2.XComponent, DecimalPlace="2", RoundType=0)  # -> Rounded, Difference
round_to_decimal_place_5 = RoundToDecimalPlace(NumberX=deconstruct_2.YComponent, DecimalPlace="2", RoundType=0)  # -> Rounded, Difference
round_to_decimal_place_6 = RoundToDecimalPlace(NumberX=deconstruct_2.ZComponent, DecimalPlace="2", RoundType=0)  # -> Rounded, Difference
round_2 = Round(Number=sort_list.Keys)  # -> Nearest, Floor, Ceiling
data = Data(flatten(sort_list.ValuesB))
text_split = TextSplit(Text=data, Separators=";")  # -> simplify(Result)
larger_than = LargerThan(FirstNumber=logarithm, SecondNumber=Slider(1.3685, range=0..10))  # -> LargerThan, OrEqualTo
panel_9 = Panel(round_2.Floor)
concatenate_2 = Concatenate(
    X=round_to_decimal_place.Rounded,
    Y=round_to_decimal_place_3.Rounded,
    Z=round_to_decimal_place_2.Rounded,
    JoinSeparator=";")
concatenate_3 = Concatenate(
    X=round_to_decimal_place_4.Rounded,
    Y=round_to_decimal_place_6.Rounded,
    Z=round_to_decimal_place_5.Rounded,
    JoinSeparator=";")
data_2 = Data(text_split)
merge_4 = Merge(Data1=graft(round_2.Floor), Data2=graft(sort_list.ValuesA))  # -> simplify(Result)
panel_10 = Panel(larger_than.LargerThan)
panel_11 = Panel(concatenate_3)
cull_pattern = CullPattern(List=flatten_tree_3, CullPattern=invert(larger_than.LargerThan))
panel_12 = Panel(concatenate_2)
panel_13 = Panel("""X
Y""")
division_6 = Division(A=merge_4, B="1000")
text_join_2 = TextJoin(Text=merge_2, Join=";")
point_2 = Point(area_2.Centroid)
panel_14 = Panel("""timestamp
id
gender
age
group""")
text_join_3 = TextJoin(Text=panel_13, Join=";")
insert_items = InsertItems(List=simplify(data_2), Item=merge_4, Indices="0", Wrap=True)
geometry = Geometry(brep_4)
proximity_3d_2 = Proximity3D(Points=cull_pattern, Group=5)  # -> Links, Topology
merge_5 = Merge(Data1=text_join_3, Data2=text_join_2)  # -> flatten(Result)
panel_15 = Panel(division_6)
flip_matrix = FlipMatrix(Data=insert_items)
deconstruct_3 = Deconstruct(Point=point_2)  # -> XComponent, YComponent, ZComponent
pull_point = PullPoint(Point=point_2, Geometry=geometry, ClosestOnly=False)  # -> ClosestPoint, Distance
division_7 = Division(A=pull_point.Distance, B="1000")
number_slider_5 = Slider(8, range=0..10)
number_slider_6 = Slider(22, range=0..100)
length_4 = Length(Curve=proximity_3d_2.Links)  # disabled
panel_17 = Panel(merge_5)
item_index = ItemIndex(List=point_2, Item=point_2)
round_3 = Round(Number=flip_matrix)  # -> Nearest, Floor, Ceiling
panel_18 = Panel("8-22")
entwine = Entwine(
    Branch00=deconstruct_3.XComponent,
    Branch01=deconstruct_3.YComponent,
    Branch02=deconstruct_3.ZComponent,
    FlattenInputs=True)
round_to_decimal_place_7 = RoundToDecimalPlace(NumberX=division_7, DecimalPlace="2", RoundType=0)  # -> Rounded, Difference
number_slider_7 = Slider(3, range=0..10)  # disabled
create_datatable = CreateDataTable(TableName="data", TableHeaders=panel_14, ValueTree=simplify(round_3.Nearest))  # -> flatten(DataTable)
loop_start = LoopStart(Repeat=Slider(2, range=0..10), Trigger=Button(), Data="0")  # -> port, Counter, Data
create_csv = CreateCSV(DataGridHeaders=panel_14, ValueTree=round_3.Nearest, Delimiter=";")  # -> flatten(CSVString)
construct_domain_2 = ConstructDomain(DomainStart="500", DomainEnd="6200")
average_2 = Average(Input=length_4)  # -> flatten(ArithmeticMean); disabled
file_path_2 = FilePath("C:\Users\secg\Documents\Noumena\projects\UI_NEX\updated\NEX_UI-main\models\json\")
division_8 = Division(A=entwine, B="1000")
construct_domain_3 = ConstructDomain(DomainStart=number_slider_5, DomainEnd=number_slider_6)
subtraction = Subtraction(A=number_slider_6, B=number_slider_5)

# ---- group: Bounds
panel_19 = Panel("6200")
panel_20 = Panel("500")

# ----
list_item_7 = ListItem(List=round_to_decimal_place_7.Rounded, Index=0, Wrap=True)  # -> flatten(Item), flatten(Item1), flatten(Item2)
number_slider_8 = Slider(0, range=0..1000)
number_slider_9 = Slider(365, range=1..365)
concatenate_4 = Concatenate(FragmentA=file_path_2, FragmentB="grid_values_08.json")
multiplication_7 = Multiplication(A=subtraction, B="2")
logarithm_2 = Logarithm(Value=average_2)  # disabled
create_dataset = CreateDataSet(DataSetName="data", DataTables=create_datatable)
addition_2 = Addition(A=loop_start.Data, B="1")
panel_22 = Panel("0")  # disabled
round_to_decimal_place_8 = RoundToDecimalPlace(NumberX=division_8, DecimalPlace="2", RoundType=0)  # -> Rounded, Difference
range_2 = Range(Domain=construct_domain_3, Steps=multiplication_7)
bounds = Bounds(Numbers=logarithm_2)  # disabled
file_path_3 = FilePath(concatenate_4)
list_length_11 = ListLength(List=range_2)
loop_end = LoopEnd(port=loop_start.port, Exit=False, Data=addition_2, TimeOutVal=0, pausedState=False, state="Constant output")
random_4 = Random(Range=construct_domain_2, Number=list_length_11, Seed=number_slider_9)
panel_23 = Panel("1")  # disabled

number_slider_10 = Slider(1200, range=0..10000)  # disabled
number_slider_11 = Slider(2900, range=0..10000)  # disabled
construct_domain_4 = ConstructDomain(DomainStart=number_slider_10, DomainEnd=number_slider_11)  # disabled
list_length_12 = ListLength(List=point)  # disabled
random_5 = Random(Range=construct_domain_4, Number=list_length_12, Seed=2)  # disabled
line_sdl_2 = LineSDL(Start=point, Direction=Vector(0, 0, 1), Length=random_5)  # disabled
length_5 = Length(Curve=line_sdl_2)  # disabled

create_json = CreateJSON(WriteJSON=Button(), FilePath=file_path_3, DataSet=create_dataset)
deconstruct_domain = DeconstructDomain(Domain=bounds)  # -> Start, End; disabled
ghpython_script_2 = GhPythonScript(x=range_2)  # -> out, hours, hr; inputs x: list
# ---------- ghpython_script_2: Python ----------
hr = []
half_hr = []

for v in x:
    val_str = str(v)
    val_spl = val_str.split('.')
    hr_val = val_spl[0]
    eval_val = val_spl[1]
    
    if eval_val == '5':
        eval_val = str(3)
    
    
    
    hr.append(hr_val)
    half_hr.append(eval_val)

val_a  = tuple(hr)
val_b = tuple(half_hr)
vals = val_a, val_b

tot_vals = zip(val_a, val_b)


hrs_ = []
for vals_hr in tot_vals:
    half_hr = '.'.join(vals_hr)
    
    hrs_.append(half_hr)




hours = hrs_ 

hr_ = hr
half_hr_ = half_hr
# ---------- end ghpython_script_2 ----------

construct_domain_5 = ConstructDomain(DomainStart=Slider(500, range=0..10000), DomainEnd=Slider(2208, range=0..10000))
random_6 = Random(Range=construct_domain_5, Number="20", Seed=2)
graft_tree = GraftTree(Tree=random_6, IncludeEmptyLists=True, IncludeNullItems=True)
line_sdl_3 = LineSDL(Start=point, Direction=Vector(0, 0, 1), Length=graft_tree)

panel_24 = Panel(create_csv)
round_to_decimal_place_9 = RoundToDecimalPlace(NumberX=random_4, DecimalPlace="2", RoundType=0)  # -> Rounded, Difference
panel_25 = Panel(loop_end)
file_path_4 = FilePath("C:\Users\secg\Documents\Noumena\projects\UI_NEX\3d_model\data.csv")  # disabled
gradient = Gradient(
    LowerLimit=deconstruct_domain.Start,
    UpperLimit=deconstruct_domain.End,
    Parameter=logarithm_2,
    stops=[0: RGB(234, 38, 0), 0.25: RGB(234, 126, 0), 0.5: RGB(254, 244, 84), 0.75: RGB(173, 203, 249), 1: RGB(75, 107, 169)])  # disabled
explode_tree = ExplodeTree(Data=round_to_decimal_place_8.Rounded)  # -> Branch0, Branch1, Branch2
boolean_toggle = BooleanToggle(True)  # disabled
loop_start_2 = LoopStart(Repeat=number_slider_7, Trigger=boolean_toggle, Data=panel_22)  # -> port, Counter, Data; disabled
addition_3 = Addition(A=loop_start_2.Data, B=panel_23)  # disabled
loop_end_2 = LoopEnd(port=loop_start_2.port, Exit=False, Data=addition_3, TimeOutVal=0, pausedState=False, state="Constant output")  # disabled
button = Button()  # disabled
list_item_8 = ListItem(List=create_csv, Index=loop_end_2, Wrap=True)  # disabled
concatenate_5 = Concatenate(
    FragmentD=item_index,
    FragmentA=explode_tree.Branch0,
    FragmentB=explode_tree.Branch2,
    FragmentC=explode_tree.Branch1,
    FragmentE=list_item_7.Item,
    FragmentF=list_item_7.Item1,
    FragmentG=list_item_7.Item2,
    JoinSeparator=";")
ghpython_script_3 = GhPythonScript(x=range_2)  # -> out, hr, half_hr; inputs x: list
# ---------- ghpython_script_3: Python ----------
hr = []
half_hr = []

for v in x:
    val_str = str(v)
    val_spl = val_str.split('.')
    hr_val = val_spl[0]
    eval_val = val_spl[1]
    
    if eval_val == '5':
        eval_val = str(3)
        eval_val = 10 * float(eval_val)
    
    hr.append(hr_val)
    half_hr.append(eval_val)


hr_ = hr
half_hr_ = half_hr
# ---------- end ghpython_script_3 ----------
construct_point_cloud = ConstructPointCloud(Points=cull_pattern, Colours=gradient)  # disabled
panel_26 = Panel(list_item_8)  # disabled
flip_matrix_2 = FlipMatrix(Data=list_item_8)  # disabled
merge_6 = Merge(Data1="id;X;Y;Z;dist1;dist2;dist3", Data2=concatenate_5)  # -> flatten(Result)
ghpython_script_4 = GhPythonScript(filename=file_path_4, d_list=list_item_8)  # -> out, a; disabled
# ---------- ghpython_script_4: Python ----------
import csv
import rhinoscriptsyntax as rs
import clr 
clr.AddReference("Grasshopper")
from Grasshopper.Kernel.Data import GH_Path
from Grasshopper import DataTree


l_data = d_list
l_csv = l_data.replace(';', ',')

splt_list = l_csv.split(",")

cols_list = [splt_list]

print(len(cols_list))

f_name = filename 




with open(f_name, 'a') as f:
    writer = csv.writer(f)
    writer.writerow(cols_list)

f.close()


a = cols_list
# ---------- end ghpython_script_4 ----------
panel_28 = Panel(merge_6)
panel_29 = Panel(ghpython_script_3.half_hr)
construct_time = ConstructTime(Hour=ghpython_script_3.hr, Minute=ghpython_script_3.half_hr, Second=0)
panel_30 = Panel(ghpython_script_4.a)
panel_31 = Panel(construct_time)
end_points = EndPoints(Curve=line_sdl_3)  # -> Start, End
file_path_5 = FilePath("C:\Users\secg\Documents\Noumena\projects\UI_NEX\3d_model\data_sales.csv")
panel_32 = Panel(round_to_decimal_place_9.Rounded)
ghpython_script_5 = GhPythonScript(time=construct_time, sales=round_to_decimal_place_9.Rounded, filename=file_path_5)  # -> out, simplify(a)
# ---------- ghpython_script_5: Python ----------
import csv
import ghpythonlib.treehelpers as th




table = time[11:], sales

a = table
# ---------- end ghpython_script_5 ----------
point_3 = Point(end_points.End)
closest_point_2 = ClosestPoint(Point=point_3, Cloud=move.Geometry)  # -> ClosestPoint, CPIndex, Distance
file_path_6 = FilePath("C:\Users\secg\Documents\Noumena\projects\UI_NEX\3d_model\data_sales.csv")
file_path_7 = FilePath("C:\Users\secg\Documents\Noumena\projects\UI_NEX\3d_model\data_sales.csv")  # disabled
number_slider_12 = Slider(1, range=0..1)
panel_33 = Panel("""time
sales""")
flip_matrix_3 = FlipMatrix(Data=ghpython_script_5.a)
list_length_13 = ListLength(List=line_sdl_3)
ghpython_script_6 = GhPythonScript(time=construct_time, sales=round_to_decimal_place_9.Rounded, filename=file_path_7)  # -> out, simplify(a); disabled
# ---------- ghpython_script_6: Python ----------
import csv
import ghpythonlib.treehelpers as th




table = time[11:], sales

#values = th.tree_to_list(table, lambda x:x)
print(zip(table))

#with open(f_name, 'w') as f:
#    writer = csv.writer(f)
#    
#    writer.writerow(['time', 'sales'])
#    for row in table:
#        print(row)
#        writer.writerow(row)

a = table
# ---------- end ghpython_script_6 ----------
text_split_2 = TextSplit(Text=file_path_6, Separators=".")
list_length_14 = ListLength(List=closest_point_2.CPIndex)
create_csv_2 = CreateCSV(DataGridHeaders=panel_33, ValueTree=flip_matrix_3, Delimiter=",")
multiplication_8 = Multiplication(A=list_length_13, B=number_slider_12)
multiplication_9 = Multiplication(A=list_length_14, B=number_slider_12)
list_item_9 = ListItem(List=text_split_2, Index=0, Wrap=True)  # -> Item, Item1
series_3 = Series(Start=0, Step=1, Count=multiplication_8)
series_4 = Series(Start=0, Step=1, Count=multiplication_9)
list_item_10 = ListItem(List=closest_point_2.CPIndex, Index=series_4, Wrap=True)
list_item_11 = ListItem(List=line_sdl_3, Index=series_3, Wrap=True)
concatenate_6 = Concatenate(FragmentA="_", FragmentB=number_slider_9)
concatenate_7 = Concatenate(FragmentA=".", FragmentB=list_item_9.Item1)
panel_34 = Panel(create_csv_2)
flatten_tree_4 = FlattenTree(Tree=list_item_10, Path="{0}")
cull_index = CullIndex(List=move.Geometry, Indices=flatten_tree_4, Wrap=True)
list_item_12 = ListItem(List=move.Geometry, Index=list_item_10, Wrap=True)
concatenate_8 = Concatenate(Fragment_A=list_item_9.Item, Fragment_B=concatenate_6, Fragment_C=concatenate_7)
panel_35 = Panel(list_item_10)
panel_36 = Panel(closest_point_2.CPIndex)
flatten_tree_5 = FlattenTree(Tree=list_item_12, Path="{0}")
create_set = CreateSet(List=list_item_10)  # -> Set, Map
ghpython_script_7 = GhPythonScript(f_name=concatenate_8, x=create_csv_2)  # -> out, a; inputs x: list
# ---------- ghpython_script_7: Python ----------
import csv 

filename = f_name

values = x



with open(filename, 'a') as f:
    writer = csv.writer(f, delimiter=',', quoting=csv.QUOTE_MINIMAL)
    
    for row in values:
        print(row.split(","))
        writer.writerow(row.split(","))

a = values
# ---------- end ghpython_script_7 ----------
number_slider_13 = Slider(0.001, range=0..0.001)
number_slider_14 = Slider(62.36, range=0..1000)  # disabled
create_set_2 = CreateSet(List=create_set.Map)  # -> Set, Map
sphere_2 = Sphere(Base=cull_index, Radius=number_slider_14)  # disabled
member_index = MemberIndex(Set=create_set.Map, Member=create_set_2.Set)  # -> Index, Count
cull_duplicates = CullDuplicates(Points=list_item_12, Tolerance=number_slider_13, CullMode=1)  # -> Points, Indices, Valence
panel_37 = Panel(member_index.Count)
mass_addition_2 = MassAddition(Input=member_index.Count)  # -> Result, PartialResults
shift_paths = ShiftPaths(Data=cull_duplicates.Points, Offset=-1)
flatten_tree_6 = FlattenTree(Tree=mass_addition_2.PartialResults, Path="{0}")
panel_38 = Panel(mass_addition_2.PartialResults)
flatten_tree_7 = FlattenTree(Tree=shift_paths, Path="{0}")
cull_duplicates_2 = CullDuplicates(Points=flatten_tree_7, Tolerance=number_slider_13, CullMode=1)  # -> Points, Indices, Valence
list_item_13 = ListItem(List=flatten_tree_6, Index=cull_duplicates_2.Indices, Wrap=True)
number_slider_15 = Slider(99.6, range=0..1000)
number_slider_16 = Slider(210, range=0..1000)
bounds_2 = Bounds(Numbers=list_item_13)
construct_domain_6 = ConstructDomain(DomainStart=number_slider_15, DomainEnd=number_slider_16)
remap_numbers = RemapNumbers(Value=list_item_13, Source=bounds_2, Target=construct_domain_6)  # -> Mapped, Clipped
sphere_3 = Sphere(Base=cull_duplicates_2.Points, Radius=remap_numbers.Mapped)
gradient_2 = Gradient(
    LowerLimit=number_slider_15,
    UpperLimit=number_slider_16,
    Parameter=remap_numbers.Mapped,
    stops=[0: RGB(234, 38, 0), 0.25: RGB(234, 126, 0), 0.5: RGB(254, 244, 84), 0.75: RGB(173, 203, 249), 1: RGB(75, 107, 169)])
panel_39 = Panel(remap_numbers.Mapped)
custom_preview_2 = CustomPreview(Geometry=sphere_3, Material=gradient_2)
curve_12 = Curve([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])
graft_tree_2 = GraftTree(Tree=curve_12, IncludeEmptyLists=True, IncludeNullItems=True)
point_on_curve = PointOnCurve(graft_tree_2, parameter=0.5)

discontinuity = Discontinuity(Curve=graft_tree_2, Level=1)  # -> Points, Parameters
panel_40 = Panel(discontinuity.Points)
flip_matrix_4 = FlipMatrix(Data=discontinuity.Points)
list_item_14 = ListItem(List=flip_matrix_4, Index=0, Wrap=True)
clean_tree = CleanTree(RemoveNulls=True, RemoveInvalid=True, RemoveEmpty=False, Tree=list_item_14)  # -> flatten(Tree)
panel_41 = Panel(list_item_14)
point_list = PointList(Points=flatten(list_item_14), Size=Slider(0.005, range=0..0.01))
construct_domain_7 = ConstructDomain(DomainStart=Slider(0, range=0..10), DomainEnd=Slider(60, range=0..100))
list_length_15 = ListLength(List=flatten(clean_tree))
shift_paths_2 = ShiftPaths(Data=list_item_14, Offset=-1)
panel_42 = Panel(clean_tree)
panel_43 = Panel(list_length_15)
panel_44 = Panel(shift_paths_2)
range_3 = Range(Domain=construct_domain_7, Steps=list_length_15)
panel_45 = Panel(range_3)
construct_time_2 = ConstructTime(Hour="8", Minute=range_3, Second=0)
panel_46 = Panel(construct_time_2)

flatten_tree_8 = FlattenTree(Tree=point_on_curve, Path="{0}")
length_6 = Length(Curve=flatten(graft_tree_2))
list_length_16 = ListLength(List=flatten_tree_8)
division_9 = Division(A=list_length_16, B="3")
panel_47 = Panel(length_6)
partition_list = PartitionList(List=flatten_tree_8, Size=division_9)
partition_list_2 = PartitionList(List=length_6, Size=division_9)
list_indices_2 = ListIndices(List=partition_list)
replace_nulls = ReplaceNulls(Items=partition_list_2, Replacements=Slider(0.9, range=0..1))  # -> Items, Count
panel_48 = Panel(partition_list_2)
merge_7 = Merge(Data1="Designer", Data2="Engineer", Data3="Computer_Scientist")  # -> graft(Result)
panel_49 = Panel(replace_nulls.Items)
concatenate_9 = Concatenate(Fragment_A=merge_7, Fragment_B=list_indices_2, JoinSeparator="-")
panel_50 = Panel(concatenate_9)
text_tag_3d_2 = TextTag3D(Location=partition_list, Text=concatenate_9, Size=Slider(0.0917, range=0..1), Justification=7)
construct_domain_8 = ConstructDomain(DomainStart=0, DomainEnd=Slider(1, range=0..1))
sub_curve = SubCurve(BaseCurve=reparameterize(graft_tree_2), Domain=construct_domain_8)
discontinuity_2 = Discontinuity(Curve=sub_curve, Level=1)  # -> Points, Parameters
flip_matrix_5 = FlipMatrix(Data=discontinuity_2.Points)
clean_tree_2 = CleanTree(RemoveNulls=True, RemoveInvalid=True, RemoveEmpty=False, Tree=flip_matrix_5)  # -> flatten(Tree)
panel_51 = Panel(clean_tree_2)
point_list_2 = PointList(Points=flatten(flip_matrix_5), Size=Slider(0.005, range=0..0.01))
list_length_17 = ListLength(List=discontinuity_2.Points)  # -> flatten(Length)
construct_domain_9 = ConstructDomain(DomainStart=Slider(0, range=0..10), DomainEnd=Slider(60, range=0..100))
list_length_18 = ListLength(List=flatten(clean_tree_2))
shift_paths_3 = ShiftPaths(Data=flip_matrix_5, Offset=-1)
panel_52 = Panel(list_length_18)
panel_53 = Panel(shift_paths_3)
range_4 = Range(Domain=construct_domain_9, Steps=list_length_18)
range_5 = Range(Domain=construct_domain_9, Steps=list_length_18)

panel_54 = Panel(discontinuity_2.Points)
mass_addition_3 = MassAddition(Input=list_length_17)  # -> Result, PartialResults
panel_55 = Panel(mass_addition_3.Result)

panel_56 = Panel(range_4)
construct_time_3 = ConstructTime(Hour="8", Minute=range_4, Second=range_5)
partition_list_3 = PartitionList(List=construct_time_3, Size=list_length_17)
panel_57 = Panel(construct_time_3)
ghpython_script_8 = GhPythonScript(t=construct_time_3)  # -> out, time_results_seconds, time_results_minutes; inputs t: list
# ---------- ghpython_script_8: Python ----------
import datetime


time_convert = []
time_convert_min = []


for i in t:
    t_str = str(i)
    
    (h, m, s) = t_str.split(':')
    
    
    hour_split = h.split()
    hour = hour_split[1]
    #print(hour)
    
    r = int(hour) * 3600 + int(m) * 60 + int(s)
    time_convert.append(r)
    
    time_min = r/60
    time_convert_min.append(time_min)

time_results_seconds = time_convert
time_results_minutes = time_convert_min
# ---------- end ghpython_script_8 ----------

tree_statistics_2 = TreeStatistics(Tree=partition_list_3)  # -> Paths, Length, Count
list_item_15 = ListItem(List=tree_statistics_2.Paths, Index=0, Wrap=True)
tree_branch = TreeBranch(Tree=partition_list_3, Path=list_item_15, MaintainPaths=True)
list_item_16 = ListItem(List=tree_branch, Index="-1", Wrap=True)
list_item_17 = ListItem(List=tree_branch, Index=0, Wrap=True)
panel_58 = Panel(list_item_17)
panel_59 = Panel(list_item_16)
ghpython_script_9 = GhPythonScript(x=list_item_17, y=list_item_16)  # -> out, a
# ---------- ghpython_script_9: Python ----------
import datetime

time_ = y - x
print(time_)

a = time_
# ---------- end ghpython_script_9 ----------
panel_60 = Panel(ghpython_script_9.a)

panel_61 = Panel(partition_list_3)
panel_62 = Panel(ghpython_script_8.time_results_seconds)
panel_63 = Panel(tree_branch)

list_item_18 = ListItem(List=partition_list_3, Index=0, Wrap=True)  # -> flatten(Item)
list_item_19 = ListItem(List=partition_list_3, Index="-1", Wrap=True)  # -> flatten(Item)

panel_64 = Panel(list_item_18)
panel_65 = Panel(list_item_19)
list_item_20 = ListItem(List=list_item_18, Index=Slider(3, range=0..10), Wrap=True)
list_item_21 = ListItem(List=list_item_19, Index=Slider(5, range=0..10), Wrap=True)
clean_tree_3 = CleanTree(RemoveNulls=True, RemoveInvalid=True, RemoveEmpty=invert(False), Tree=list_item_18)
clean_tree_4 = CleanTree(RemoveNulls=True, RemoveInvalid=True, RemoveEmpty=invert(False), Tree=list_item_19)
replace_nulls_2 = ReplaceNulls(Items=list_item_18, Replacements=list_item_20)  # -> Items, Count
replace_nulls_3 = ReplaceNulls(Items=list_item_19, Replacements=list_item_21)  # -> Items, Count
panel_66 = Panel(clean_tree_3)
panel_67 = Panel(clean_tree_4)
ghpython_script_10 = GhPythonScript(x=replace_nulls_2.Items, y=replace_nulls_3.Items)  # -> out, a; inputs x: list, y: list
# ---------- ghpython_script_10: Python ----------
import datetime


time = []

for i, j in zip(x, y):
    t = j - i
    time.append(t)


a = time
# ---------- end ghpython_script_10 ----------
panel_68 = Panel(ghpython_script_10.a)

ghpython_script_11 = GhPythonScript(t=ghpython_script_10.a)  # -> out, time_results_seconds, time_results_minutes; inputs t: list
# ---------- ghpython_script_11: Python ----------
import datetime


time_convert = []
time_convert_min = []


for i in t:
    t_str = str(i)
    
    (h, m, s) = t_str.split(':')
    r = int(h) * 3600 + int(m) * 60 + int(s)
    time_convert.append(r)
    
    time_min = r/60
    time_convert_min.append(time_min)

time_results_seconds = time_convert
time_results_minutes = time_convert_min
# ---------- end ghpython_script_11 ----------
panel_69 = Panel(ghpython_script_11.time_results_seconds)
panel_70 = Panel(ghpython_script_11.time_results_minutes)
